# Grasshopper definition Case Study - Basic model.gh (Grasshopper 0.9.76)
# plug-ins: Karamba, MeshEdit Components, treesloth01, ColourMesh

# ---- group: The geometric model
# Basketball court:
# This is just a box with the dimensions of the basketball court. This could also be imported from Rhino.
panel = Panel("34")
panel_2 = Panel("7")
pt = ConstructPoint(XCoordinate=0, YCoordinate=0, ZCoordinate=0)
pt_2 = ConstructPoint(XCoordinate=panel, YCoordinate=0, ZCoordinate=0)
pt_3 = ConstructPoint(XCoordinate=panel, YCoordinate="19", ZCoordinate=0)
pt_4 = ConstructPoint(XCoordinate=0, YCoordinate="19", ZCoordinate=0)
srf4pt = _4PointSurface(CornerA=pt, CornerB=pt_2, CornerC=pt_3, CornerD=pt_4)
dom = ConstructDomain(DomainStart=0, DomainEnd=panel_2)
boxrec = BoxRectangle(Rectangle=srf4pt, Height=dom)

# ----
# Calculation of the snowload
μi = Panel("0.8")
sk = Panel("0.5")
ce = Panel("1")
ct = Panel("1")
mm = MassMultiplication(Input=[μi, sk, ce, ct])  # -> Result, PartialResults

# ----
# The structural analysis
# Calculation of the windload
panel_3 = Panel("Input for Karamba")

panel_4 = Panel("Output data Karamaba")

# ----
# Point grid for the local loads.
box = Box(boxrec)
boxprop = BoxProperties(Box=box)  # -> Center, Diagonal, Area, Volume, Degeneracy
debox = DeconstructBox(Box=box)  # -> Plane, X, Y, Z
project = Project(Geometry=boxprop.Center, Plane=PlaneXY(0, 0, 0))  # -> Geometry, Transform
dedomain = DeconstructDomain(Domain=debox.X)  # -> Start, End
dedomain_2 = DeconstructDomain(Domain=debox.Y)  # -> Start, End
xy = XYPlane(Origin=project.Geometry)
subtraction = Subtraction(A=dedomain.End, B=dedomain.Start)
subtraction_2 = Subtraction(A=dedomain_2.End, B=dedomain_2.Start)
multiplication = Multiplication(A=subtraction, B="0.4")
multiplication_2 = Multiplication(A=subtraction_2, B="0.4")
dom_2 = ConstructDomain(DomainStart=expr("-x/2", multiplication), DomainEnd=expr("x/2", multiplication))
dom_3 = ConstructDomain(DomainStart=expr("-x/2", multiplication_2), DomainEnd=expr("x/2", multiplication_2))
multiplication_3 = Multiplication(A=multiplication, B="2")
multiplication_4 = Multiplication(A=multiplication_2, B="2")
planesrf = PlaneSurface(Plane=xy, XSize=dom_2, YSize=dom_3)
sdivide = DivideSurface(Surface=planesrf, UCount=multiplication_3, VCount=multiplication_4)  # -> flatten(Points), Normals, Parameters
trim = TrimTree(Tree=simplify(sdivide.Points), Depth="0")

# ---- group: Parameters guide line A-B-C
# The parameters that will adapt the geometric model and that are managed by the optimisation process.
ya = Slider(3, range=3..10)
yb = Slider(5, range=3..10)
yc = Slider(5, range=3..10)

# ---- group: The geometric model
# First guideline A-B-C:
# This is the first curve that controls the curved surface. In this case only the Y-parameters are used, the movement in the X-direction has been set to 0.
pdecon = Deconstruct(Point=pt)  # -> XComponent, YComponent, ZComponent
pdecon_2 = Deconstruct(Point=pt_2)  # -> XComponent, YComponent, ZComponent
xa = Slider(0, range=0..5)
xc = Slider(0, range=0..5)
expression = Expression(x=pdecon.XComponent, y=pdecon_2.XComponent, Expression="(x+y)/2")
expression_2 = Expression(x=pdecon.YComponent, y=pdecon_2.YComponent, Expression="(x+y)/2")
vec = VectorXYZ(XComponent=expr("-x", xa), YComponent=expr("-x", ya), ZComponent=0)  # -> Vector, Length
vec_2 = VectorXYZ(XComponent=xc, YComponent=expr("-x", yc), ZComponent=0)  # -> Vector, Length
subtraction_3 = Subtraction(A=expression_2, B=yb)
move = Move(Geometry=pt, Motion=vec.Vector)  # -> Geometry, Transform
pt_5 = ConstructPoint(XCoordinate=expression, YCoordinate=subtraction_3, ZCoordinate=0)
move_2 = Move(Geometry=pt_2, Motion=vec_2.Vector)  # -> Geometry, Transform
intcrv = Interpolate(Vertices=[move.Geometry, pt_5, move_2.Geometry], Degree=3, Periodic=False, KnotStyle=1)  # -> Curve, Length, Domain

# ---- group: Parameters guide line D-E-F
yd = Slider(3, range=3..10)
ye = Slider(5, range=3..10)
yf = Slider(5, range=3..10)

# ---- group: The geometric model / Guideline DF
# Second guideline D-E-F:
# This is the second curve that controls the curved surface. In this case only the Y-parameters are used, the movement in the X-direction has been set to 0.
pdecon_3 = Deconstruct(Point=pt_3)  # -> XComponent, YComponent, ZComponent
pdecon_4 = Deconstruct(Point=pt_4)  # -> XComponent, YComponent, ZComponent
xf = Slider(0, range=0..5)
xd = Slider(0, range=0..5)
expression_3 = Expression(x=pdecon_3.XComponent, y=pdecon_4.XComponent, Expression="(x+y)/2")
expression_4 = Expression(x=pdecon_3.YComponent, y=pdecon_4.YComponent, Expression="(x+y)/2")
vec_3 = VectorXYZ(XComponent=expr("-x", xd), YComponent=yd, ZComponent=0)  # -> Vector, Length
addition = Addition(A=expression_4, B=ye)
vec_4 = VectorXYZ(XComponent=xf, YComponent=yf, ZComponent=0)  # -> Vector, Length
pt_6 = ConstructPoint(XCoordinate=expression_3, YCoordinate=addition, ZCoordinate=0)
move_3 = Move(Geometry=pt_4, Motion=vec_3.Vector)  # -> Geometry, Transform
move_4 = Move(Geometry=pt_3, Motion=vec_4.Vector)  # -> Geometry, Transform
intcrv_2 = Interpolate(Vertices=[move_3.Geometry, pt_6, move_4.Geometry], Degree=3, Periodic=False, KnotStyle=1)  # -> Curve, Length, Domain

# ----
# 1/250 of the span is set as maximum value of the displacement with an absolute max of 5cm
dist = Distance(PointA=move.Geometry, PointB=move_3.Geometry)
dist_2 = Distance(PointA=move_2.Geometry, PointB=move_4.Geometry)
max = Maximum(A=dist, B=dist_2)
division = Division(A=max, B=250)

# ---- group: Parameters guide line G-H-I
zg = Slider(5, range=3..10)
zh = Slider(4, range=3..10)
zi = Slider(4, range=3..10)

# ---- group: The geometric model
addition_2 = Addition(A=panel_2, B=zh)

# Second guideline G-H-I:
# This is the last curve that controls the curved surface. In this case only the Z-parameters are used, the movement in the X and Y-direction has been set to 0. The guide line is situated in the middel of the basketball court.
pdecon_5 = Deconstruct(Point=move.Geometry)  # -> XComponent, YComponent, ZComponent
pdecon_6 = Deconstruct(Point=move_3.Geometry)  # -> XComponent, YComponent, ZComponent
pdecon_7 = Deconstruct(Point=move_2.Geometry)  # -> XComponent, YComponent, ZComponent
pdecon_8 = Deconstruct(Point=move_4.Geometry)  # -> XComponent, YComponent, ZComponent
xg = Slider(0, range=-2..2)
xi = Slider(0, range=-2..2)
yg = Slider(0, range=-10..10)
yh = Slider(0, range=-10..10)
yi = Slider(0, range=-10..10)
expression_5 = Expression(x=pdecon_5.XComponent, y=pdecon_6.XComponent, Expression="(x+y)/2")
expression_6 = Expression(x=pdecon_5.YComponent, y=pdecon_6.YComponent, Expression="(x+y)/2")
expression_7 = Expression(x=pdecon_7.XComponent, y=pdecon_8.XComponent, Expression="(x+y)/2")
expression_8 = Expression(x=pdecon_7.YComponent, y=pdecon_8.YComponent, Expression="(x+y)/2")
addition_3 = Addition(A=expression_5, B=xg)
addition_4 = Addition(A=expression_6, B=yg)
addition_5 = Addition(A=panel_2, B=zg)
addition_6 = Addition(A=expression_7, B=xi)
addition_7 = Addition(A=expression_8, B=yi)
addition_8 = Addition(A=panel_2, B=zi)
pt_7 = ConstructPoint(XCoordinate=addition_3, YCoordinate=addition_4, ZCoordinate=addition_5)
pdecon_9 = Deconstruct(Point=pt_7)  # -> XComponent, YComponent, ZComponent
pt_8 = ConstructPoint(XCoordinate=addition_6, YCoordinate=addition_7, ZCoordinate=addition_8)
pdecon_10 = Deconstruct(Point=pt_8)  # -> XComponent, YComponent, ZComponent
expression_9 = Expression(x=pdecon_9.XComponent, y=pdecon_10.XComponent, Expression="(x+y)/2")
expression_10 = Expression(x=pdecon_9.YComponent, y=pdecon_10.YComponent, Expression="(x+y)/2")
expression_11 = Expression(x=pdecon_9.ZComponent, y=pdecon_10.ZComponent, Expression="(x+y)/2")
addition_9 = Addition(A=expression_10, B=yh)
pt_9 = ConstructPoint(XCoordinate=expression_9, YCoordinate=addition_9, ZCoordinate=addition_2)
intcrv_3 = Interpolate(Vertices=[pt_7, pt_9, pt_8], Degree=3, Periodic=False, KnotStyle=1)  # -> Curve, Length, Domain

# Curved surface:
# Based on the guidelines a curved surface is created.
arc = Arc3Pt(PointA=move.Geometry, PointB=pt_7, PointC=move_3.Geometry)  # -> Arc, Plane, Radius
arc_2 = Arc3Pt(PointA=pt_5, PointB=pt_9, PointC=pt_6)  # -> Arc, Plane, Radius
arc_3 = Arc3Pt(PointA=move_2.Geometry, PointB=pt_8, PointC=move_4.Geometry)  # -> Arc, Plane, Radius
netsurf = NetworkSurface(CurvesU=[arc.Arc, arc_2.Arc, arc_3.Arc], CurvesV=[intcrv.Curve, intcrv_3.Curve, intcrv_2.Curve], Continuity=2)

# ---- group: Fold parameters
elements = Slider(5, range=3..30)
rows = Slider(10, range=2..30)

# ---- group: The geometric model
# Normal division:
# When you don't want to use the triangle variation parameters, you could connect this component straigth with the flip componenent instead of using the route above.
sdivide_2 = DivideSurface(Surface=netsurf, UCount=expr("x*2", elements), VCount=expr("x*2", rows))  # -> simplify(Points), Normals, Parameters

# ----
pt_10 = ConstructPoint(XCoordinate=expr("-x", yb), YCoordinate=0, ZCoordinate=0)
pt_11 = ConstructPoint(XCoordinate=expr("x+19", ye), YCoordinate=0, ZCoordinate=0)
pt_12 = ConstructPoint(XCoordinate=10.5, YCoordinate=expr("x+7", zh), ZCoordinate=0)
pt_13 = ConstructPoint(XCoordinate=0, YCoordinate=0, ZCoordinate=0)
pt_14 = ConstructPoint(XCoordinate=19, YCoordinate=7, ZCoordinate=0)
rec_2pt = Rectangle2Pt(Plane=PlaneXY(0, 0, 0), PointA=pt_13, PointB=pt_14, Radius=0)  # -> Rectangle, Length
arc_4 = Arc3Pt(PointA=pt_10, PointB=pt_12, PointC=pt_11)  # -> Arc, Plane, Radius
divide = DivideCurve(Curve=arc_4.Arc, Count=expr("x*2", elements), Kinks=False)  # -> flatten(Points), Tangents, Parameters
boundary = BoundarySurfaces(Edges=rec_2pt.Rectangle)
cull = CullPattern(List=divide.Points, CullPattern=[True, False])
cull_2 = CullPattern(List=divide.Points, CullPattern=[False, True])
cull_i = CullIndex(List=cull, Indices=0, Wrap=True)
cull_i_2 = CullIndex(List=cull_2, Indices=0, Wrap=True)
ln = Line(StartPoint=flatten(cull), EndPoint=flatten(cull_i))
ln_2 = Line(StartPoint=cull_2, EndPoint=cull_i_2)
srfsplit = SurfaceSplit(Surface=flatten(boundary), Curves=flatten([ln, ln_2]))  # -> reverse(Fragments)
item = ListItem(List=srfsplit, Index=0, Wrap=True)
area = Area(Geometry=item)  # -> Area, Centroid
num = Number(area.Area)

pt_15 = ConstructPoint(XCoordinate=expr("-x", ya), YCoordinate=0, ZCoordinate=0)
pt_16 = ConstructPoint(XCoordinate=10.5, YCoordinate=expr("x+7", zg), ZCoordinate=0)
pt_17 = ConstructPoint(XCoordinate=expr("x+19", yd), YCoordinate=0, ZCoordinate=0)
# 2D validation for intersection on three locations.
pt_18 = ConstructPoint(XCoordinate=0, YCoordinate=0, ZCoordinate=0)
pt_19 = ConstructPoint(XCoordinate=19, YCoordinate=7, ZCoordinate=0)
rec_2pt_2 = Rectangle2Pt(Plane=PlaneXY(0, 0, 0), PointA=pt_18, PointB=pt_19, Radius=0)  # -> Rectangle, Length
arc_5 = Arc3Pt(PointA=pt_15, PointB=pt_16, PointC=pt_17)  # -> Arc, Plane, Radius
divide_2 = DivideCurve(Curve=arc_5.Arc, Count=expr("x*2", elements), Kinks=False)  # -> flatten(Points), Tangents, Parameters
boundary_2 = BoundarySurfaces(Edges=rec_2pt_2.Rectangle)
cull_3 = CullPattern(List=divide_2.Points, CullPattern=[True, False])
cull_4 = CullPattern(List=divide_2.Points, CullPattern=[False, True])
cull_i_3 = CullIndex(List=cull_3, Indices=0, Wrap=True)
cull_i_4 = CullIndex(List=cull_4, Indices=0, Wrap=True)
ln_3 = Line(StartPoint=flatten(cull_3), EndPoint=flatten(cull_i_3))
ln_4 = Line(StartPoint=cull_4, EndPoint=cull_i_4)
srfsplit_2 = SurfaceSplit(Surface=flatten(boundary_2), Curves=flatten([ln_3, ln_4]))
item_2 = ListItem(List=srfsplit_2, Index=0, Wrap=True)
area_2 = Area(Geometry=item_2)  # -> Area, Centroid
num_2 = Number(area_2.Area)

pt_20 = ConstructPoint(XCoordinate=expr("-x", yc), YCoordinate=0, ZCoordinate=0)
pt_21 = ConstructPoint(XCoordinate=expr("x+19", yf), YCoordinate=0, ZCoordinate=0)
pt_22 = ConstructPoint(XCoordinate=10.5, YCoordinate=expr("x+7", zi), ZCoordinate=0)
pt_23 = ConstructPoint(XCoordinate=0, YCoordinate=0, ZCoordinate=0)
pt_24 = ConstructPoint(XCoordinate=19, YCoordinate=7, ZCoordinate=0)
rec_2pt_3 = Rectangle2Pt(Plane=PlaneXY(0, 0, 0), PointA=pt_23, PointB=pt_24, Radius=0)  # -> Rectangle, Length
arc_6 = Arc3Pt(PointA=pt_20, PointB=pt_22, PointC=pt_21)  # -> Arc, Plane, Radius
divide_3 = DivideCurve(Curve=arc_6.Arc, Count=expr("x*2", elements), Kinks=False)  # -> flatten(Points), Tangents, Parameters
boundary_3 = BoundarySurfaces(Edges=rec_2pt_3.Rectangle)
cull_5 = CullPattern(List=divide_3.Points, CullPattern=[True, False])
cull_6 = CullPattern(List=divide_3.Points, CullPattern=[False, True])
cull_i_5 = CullIndex(List=cull_5, Indices=0, Wrap=True)
cull_i_6 = CullIndex(List=cull_6, Indices=0, Wrap=True)
ln_5 = Line(StartPoint=flatten(cull_5), EndPoint=flatten(cull_i_5))
ln_6 = Line(StartPoint=cull_6, EndPoint=cull_i_6)
srfsplit_3 = SurfaceSplit(Surface=flatten(boundary_3), Curves=flatten([ln_5, ln_6]))  # -> reverse(Fragments)
item_3 = ListItem(List=srfsplit_3, Index=0, Wrap=True)
area_3 = Area(Geometry=item_3)  # -> Area, Centroid
num_3 = Number(area_3.Area)

# ---- group: Plate thickness parameter
thickness = Slider(5, range=5..20)

# ---- group: Triangle variation parameters
xvar = Slider(0, range=0..2)
yvar = Slider(0, range=0..2)

# ---- group: The geometric model
# Triangle variation:
# This serie of components realises a point grid on the curved surface. The triangle variation parameters can select a graph which adapts the density of the points in certain areas. When for bot parameters zero is selected all the points are on equal distance. The amounts of points is controlled by the fold parameters.
range = Range(Domain=Domain(0, 1), Steps=expr("x*2", rows))
range_2 = Range(Domain=Domain(0, 1), Steps=expr("x*2", elements))
graph = GraphMapper(range, x0=0, x1=1, y0=0, y1=1, container_name="Bezier", cpx=[0, 1, 0, 1], cpy=[0, 1, 0, 1])
graph_2 = GraphMapper(range_2, x0=0, x1=1, y0=0, y1=1, container_name="Bezier", cpx=[0, 1, 0, 1], cpy=[0, 1, 0, 1])
graph_3 = GraphMapper(
    range_2,
    x0=0,
    x1=1,
    y0=0,
    y1=1,
    container_name="Bezier",
    cpx=[0, 0.7025316358, 0.2974683642, 1],
    cpy=[0, 0.1970803142, 0.8029196858, 1])
graph_4 = GraphMapper(
    range,
    x0=0,
    x1=1,
    y0=0,
    y1=1,
    container_name="Bezier",
    cpx=[0, 0.2113923728, 0.788607657, 1],
    cpy=[0, 0.6029195189, 0.3985399604, 1])
graph_5 = GraphMapper(
    range,
    x0=0,
    x1=1,
    y0=0,
    y1=1,
    container_name="Bezier",
    cpx=[0, 0.7025316358, 0.2974683642, 1],
    cpy=[0, 0.1970803142, 0.8029196858, 1])
graph_6 = GraphMapper(
    range_2,
    x0=0,
    x1=1,
    y0=0,
    y1=1,
    container_name="Bezier",
    cpx=[0, 0.2113923728, 0.788607657, 1],
    cpy=[0, 0.6029195189, 0.3985399604, 1])
stack = StackTrees(Data0=graph, Data1=graph_4, Data2=graph_5, Reduce=True)
stack_2 = StackTrees(Data0=graph_2, Data1=graph_6, Data2=graph_3, Reduce=True)
branch = TreeBranch(Tree=stack, Path=xvar, MaintainPaths=True)
branch_2 = TreeBranch(Tree=stack_2, Path=yvar, MaintainPaths=True)
pt_25 = ConstructPoint(XCoordinate=graft(branch_2), YCoordinate=branch, ZCoordinate=0)
evalsrf = EvaluateSurface(Surface=reparameterize(netsurf), Point=pt_25)  # -> simplify(Point), Normal, Frame

# ---- group: The geometric model / Folded structure
# In this part the triangular plates are created starting from a grid of points.
flip = FlipMatrix(Data=evalsrf.Point)
split = SplitTree(Data=flip, Masks=flatten("{*;0,2,...}"))  # -> simplify(Positive), simplify(Negative)
cull_7 = CullPattern(List=split.Positive, CullPattern=[True, False])
cull_8 = CullPattern(List=split.Negative, CullPattern=[False, True])
trim_2 = TrimDataEnds(Data=cull_7, ListStart=0, ListEnd=1, PathStart=0, PathEnd=0, RenumberPaths=True)
trim_3 = TrimDataEnds(Data=cull_7, ListStart=1, ListEnd=0, PathStart=0, PathEnd=0, RenumberPaths=True)
trim_4 = TrimDataEnds(Data=cull_8, ListStart=0, ListEnd=1, PathStart=0, PathEnd=0, RenumberPaths=True)
trim_5 = TrimDataEnds(Data=cull_8, ListStart=1, ListEnd=0, PathStart=0, PathEnd=0, RenumberPaths=True)
trim_6 = TrimDataEnds(Data=cull_7, ListStart=0, ListEnd=1, PathStart=0, PathEnd=1, RenumberPaths=True)
trim_7 = TrimDataEnds(Data=cull_7, ListStart=1, ListEnd=0, PathStart=0, PathEnd=1, RenumberPaths=True)
trim_8 = TrimDataEnds(Data=cull_7, ListStart=0, ListEnd=1, PathStart=1, PathEnd=0, RenumberPaths=True)
trim_9 = TrimDataEnds(Data=cull_7, ListStart=1, ListEnd=0, PathStart=1, PathEnd=0, RenumberPaths=True)
ln_7 = Line(StartPoint=trim_2, EndPoint=trim_3)  # -> simplify(Line)
ln_8 = Line(StartPoint=trim_4, EndPoint=trim_5)  # -> simplify(Line)
ln_9 = Line(StartPoint=cull_8, EndPoint=trim_6)  # -> simplify(Line)
ln_10 = Line(StartPoint=cull_8, EndPoint=trim_7)  # -> simplify(Line)
ln_11 = Line(StartPoint=trim_8, EndPoint=cull_8)  # -> simplify(Line)
ln_12 = Line(StartPoint=trim_9, EndPoint=cull_8)  # -> simplify(Line)
trim_10 = TrimDataEnds(Data=ln_7, ListStart=0, ListEnd=0, PathStart=0, PathEnd=1, RenumberPaths=True)
trim_11 = TrimDataEnds(Data=ln_9, ListStart=1, ListEnd=0, PathStart=0, PathEnd=0, RenumberPaths=True)
trim_12 = TrimDataEnds(Data=ln_10, ListStart=0, ListEnd=1, PathStart=0, PathEnd=0, RenumberPaths=True)
trim_13 = TrimDataEnds(Data=ln_7, ListStart=0, ListEnd=0, PathStart=1, PathEnd=0, RenumberPaths=True)
trim_14 = TrimDataEnds(Data=ln_11, ListStart=1, ListEnd=0, PathStart=0, PathEnd=0, RenumberPaths=True)
trim_15 = TrimDataEnds(Data=ln_12, ListStart=0, ListEnd=1, PathStart=0, PathEnd=0, RenumberPaths=True)
edgesrf = EdgeSurface(CurveA=trim_10, CurveB=ln_9, CurveC=ln_10)  # -> simplify(Surface)
edgesrf_2 = EdgeSurface(CurveA=ln_8, CurveB=trim_11, CurveC=trim_12)  # -> simplify(Surface)
edgesrf_3 = EdgeSurface(CurveA=trim_13, CurveB=ln_11, CurveC=ln_12)  # -> simplify(Surface)
edgesrf_4 = EdgeSurface(CurveA=ln_8, CurveB=trim_14, CurveC=trim_15)  # -> simplify(Surface)

# ---- group: The geometric model
# Extra points half triangles:
# To realise the structures with plates to the ground we had to add extra points to the grid.
pt_26 = Point(graft(arc.Arc))
pt_27 = Point(graft(arc_3.Arc))
first_last = FirstLast(List=split.Negative)  # -> FirstValue, LastValue
pl_3pt = Plane3Pt(PointA=pt_26, PointB=pt_27, PointC=first_last.FirstValue)
pl_3pt_2 = Plane3Pt(PointA=pt_26, PointB=pt_27, PointC=first_last.LastValue)
first_last_2 = FirstLast(List=cull_8)  # -> FirstValue, LastValue
mirror = MirrorSurface(Geometry=first_last_2.FirstValue, Surface=pl_3pt, Frame=True)
first_last_3 = FirstLast(List=cull_8)  # -> FirstValue, LastValue
mirror_2 = MirrorSurface(Geometry=first_last_3.LastValue, Surface=pl_3pt_2, Frame=True)
first_last_4 = FirstLast(List=cull_7)  # -> flatten(FirstValue), flatten(LastValue)
planesrf_2 = PlaneSurface(Plane=PlaneXY(0, 0, 0), XSize=Domain(-100, 100), YSize=Domain(-100, 100))
ln_13 = Line(StartPoint=mirror, EndPoint=first_last_2.FirstValue)
ln_14 = Line(StartPoint=mirror_2, EndPoint=first_last_3.LastValue)

# Half triangle plates:
# This is the creation of only the half plates at the bottom of the structure.
trim_16 = TrimDataEnds(Data=first_last_4.FirstValue, ListStart=0, ListEnd=1, PathStart=0, PathEnd=0, RenumberPaths=True)
trim_17 = TrimDataEnds(Data=first_last_4.FirstValue, ListStart=1, ListEnd=0, PathStart=0, PathEnd=0, RenumberPaths=True)
trim_18 = TrimDataEnds(Data=first_last_4.LastValue, ListStart=0, ListEnd=1, PathStart=0, PathEnd=0, RenumberPaths=True)
trim_19 = TrimDataEnds(Data=first_last_4.LastValue, ListStart=1, ListEnd=0, PathStart=0, PathEnd=0, RenumberPaths=True)
scx = SurfaceCurve(Surface=planesrf_2, Curve=ln_13)  # -> Curves, Points, UVPoints, Normals, Parameters, Tangents
scx_2 = SurfaceCurve(Surface=planesrf_2, Curve=ln_14)  # -> Curves, Points, UVPoints, Normals, Parameters, Tangents
ln_15 = Line(StartPoint=flatten(scx.Points), EndPoint=flatten(first_last_2.FirstValue))
ln_16 = Line(StartPoint=flatten(scx.Points), EndPoint=flatten(trim_16))
ln_17 = Line(StartPoint=flatten(scx.Points), EndPoint=flatten(trim_17))
ln_18 = Line(StartPoint=flatten(scx_2.Points), EndPoint=flatten(first_last_3.LastValue))
ln_19 = Line(StartPoint=flatten(scx_2.Points), EndPoint=flatten(trim_18))
ln_20 = Line(StartPoint=flatten(scx_2.Points), EndPoint=flatten(trim_19))
first_last_5 = FirstLast(List=ln_9)  # -> flatten(FirstValue), LastValue
first_last_6 = FirstLast(List=ln_11)  # -> flatten(FirstValue), LastValue
first_last_7 = FirstLast(List=ln_10)  # -> FirstValue, flatten(LastValue)
first_last_8 = FirstLast(List=ln_12)  # -> FirstValue, flatten(LastValue)
edgesrf_5 = EdgeSurface(CurveA=ln_15, CurveB=first_last_6.FirstValue, CurveC=ln_17)  # -> simplify(Surface)
edgesrf_6 = EdgeSurface(CurveA=ln_15, CurveB=ln_16, CurveC=first_last_5.FirstValue)  # -> simplify(Surface)
edgesrf_7 = EdgeSurface(CurveA=ln_18, CurveB=first_last_7.LastValue, CurveC=ln_19)  # -> simplify(Surface)
edgesrf_8 = EdgeSurface(CurveA=ln_18, CurveB=ln_20, CurveC=first_last_8.LastValue)  # -> simplify(Surface)
crv = Curve([ln_16, ln_17, ln_19, ln_20])

# ----
cluster = BasePlane()
# Creation of three different meshes for the wind load based on the angles of the elements.
flip_2 = Flip(Surface=edgesrf, Guide=cluster)  # -> Surface, Result
flip_3 = Flip(Surface=edgesrf_4, Guide=cluster)  # -> Surface, Result
flip_4 = Flip(Surface=edgesrf_2, Guide=cluster)  # -> Surface, Result
flip_5 = Flip(Surface=edgesrf_3, Guide=cluster)  # -> Surface, Result
pt_28 = ConstructPoint(XCoordinate="0.5", YCoordinate="0.5", ZCoordinate=0)
pt_29 = ConstructPoint(XCoordinate="0.5", YCoordinate="0.5", ZCoordinate=0)
pt_30 = ConstructPoint(XCoordinate="0.5", YCoordinate="-0.5", ZCoordinate=0)
pt_31 = ConstructPoint(XCoordinate="0.5", YCoordinate="-0.5", ZCoordinate=0)
evalsrf_2 = EvaluateSurface(Surface=flip_2.Surface, Point=pt_28)  # -> Point, Normal, Frame
evalsrf_3 = EvaluateSurface(Surface=flip_3.Surface, Point=pt_29)  # -> Point, Normal, Frame
evalsrf_4 = EvaluateSurface(Surface=flip_4.Surface, Point=pt_30)  # -> Point, Normal, Frame
evalsrf_5 = EvaluateSurface(Surface=flip_5.Surface, Point=pt_31)  # -> Point, Normal, Frame

# ---- group: Extreme Stuwdruk
# Calculation of the peak velocity pressure.
pdecon_11 = Deconstruct(Point=flip)  # -> XComponent, YComponent, ZComponent
sort = SortList(Keys=flatten(pdecon_11.ZComponent))  # -> Keys, ValuesA
first_last_9 = FirstLast(List=sort.Keys)  # -> FirstValue, LastValue
cprob = Panel("1")
panel_5 = Panel("26")
z0 = Panel("0.05")
Z = Panel(first_last_9.LastValue)
cdir = Panel("1")
cseason = Panel("1")
c0_z = Panel("1")
division_2 = Division(A=Z, B=z0)
mm_2 = MassMultiplication(Input=[cdir, cprob, cseason, c0_z])  # -> Result, PartialResults
ln_21 = NaturalLogarithm(Value=division_2)
log = Logarithm(Value=z0)
expression_12 = Expression(x=panel_5, y=z0, z=ln_21, u=mm_2.Result, Expression="0.19*x*(y/0.05)^(0.07)*z*u")
expression_13 = Expression(x=log, y=ln_21, Expression="(1-2*10^(-4)*(x+3)^6)/y")
expression_14 = Expression(x=expression_12, y=expression_13, Expression="(0.625*(1+7*y)*x²)/1000")

# ----
# Calculation of the pressure coefficient
pdecon_12 = Deconstruct(Point=flip)  # -> XComponent, YComponent, ZComponent
sort_2 = SortList(Keys=flatten(pdecon_12.ZComponent))  # -> Keys, ValuesA
sort_3 = SortList(Keys=flatten(pdecon_12.YComponent))  # -> Keys, ValuesA
first_last_10 = FirstLast(List=sort_2.Keys)  # -> FirstValue, LastValue
first_last_11 = FirstLast(List=sort_3.Keys)  # -> FirstValue, LastValue
subtraction_4 = Subtraction(A=first_last_11.LastValue, B=first_last_11.FirstValue)
division_3 = Division(A=first_last_10.LastValue, B=subtraction_4)
multiplication_5 = Multiplication(A=division_3, B=1.6)
subtraction_5 = Subtraction(A=-0.7, B=division_3)

# ----
# Creating points where the supports should be.
first_last_12 = FirstLast(List=ln_20)  # -> FirstValue, LastValue
len = Length(Curve=first_last_12.FirstValue)
multiplication_6 = Multiplication(A=len, B=10)
multiplication_7 = Multiplication(A="0.5", B=10)
division_4 = Division(A=multiplication_6, B=multiplication_7)
round = Round(Number=division_4)  # -> Nearest, Floor, Ceiling
integer_division = IntegerDivision(A=multiplication_6, B=multiplication_7)
max_2 = Maximum(A=round.Ceiling, B="1")
divide_4 = DivideCurve(Curve=crv, Count=max_2, Kinks=False)  # -> Points, Tangents, Parameters

# ---- group: Width Element
# Calculation of length and width of the elements. There's searched for the maximum value for each.
pt_32 = Point(simplify(trim_3))
line = Line(simplify(ln_8))
pt_33 = Point(simplify(cull_8))
line_2 = Line(simplify(ln_7))
split_2 = SplitTree(Data=pt_32, Masks=flatten("{!0}"))  # -> simplify(Positive), Negative
shift = ShiftList(List=pt_32, Shift=expr("-1", 1), Wrap=True)
shift_2 = ShiftList(List=split_2.Positive, Shift=expr("-1", 1), Wrap=True)
split_3 = SplitTree(Data=line_2, Masks=flatten("{!0}"))  # -> Positive, Negative
cull_i_7 = CullIndex(List=shift, Indices=0, Wrap=True)
cull_i_8 = CullIndex(List=shift_2, Indices=0, Wrap=True)
pull = PullPoint(Point=cull_i_7, Geometry=line, ClosestOnly=True)  # -> ClosestPoint, flatten(Distance)
pull_2 = PullPoint(Point=cull_i_8, Geometry=line, ClosestOnly=True)  # -> ClosestPoint, flatten(Distance)
pull_3 = PullPoint(Point=pt_33, Geometry=split_3.Positive, ClosestOnly=True)  # -> ClosestPoint, flatten(Distance)
pull_4 = PullPoint(Point=pt_33, Geometry=line_2, ClosestOnly=True)  # -> ClosestPoint, flatten(Distance)
sort_4 = SortList(Keys=[pull.Distance, pull_2.Distance, pull_3.Distance, pull_4.Distance])  # -> reverse(Keys), ValuesA
item_4 = ListItem(List=sort_4.Keys, Index=0, Wrap=True)

# ---- group: Length Element
dist_3 = Distance(PointA=trim_2, PointB=trim_3)  # -> flatten(Distance)
dist_4 = Distance(PointA=trim_4, PointB=trim_5)  # -> flatten(Distance)
sort_5 = SortList(Keys=[dist_3, dist_4])  # -> reverse(Keys), ValuesA
item_5 = ListItem(List=sort_5.Keys, Index=0, Wrap=True)

# ----
# Calculation of the total length of the wireframe
crv_2 = Curve([ln_18, ln_15, crv])
len_2 = Length(Curve=flatten([ln_7, ln_8, ln_9, ln_11, ln_10, ln_12]))
len_3 = Length(Curve=crv_2)
ma = MassAddition(Input=[len_2, len_3])  # -> Result, PartialResults

sort_6 = SortList(Keys=[item_5, item_4])  # -> Keys, ValuesA
item_6 = ListItem(List=sort_6.Keys, Index=1, Wrap=True)
item_7 = ListItem(List=sort_6.Keys, Index=0, Wrap=True)

# ---- group: The geometric model
# This is the final mesh that's the result of the first step 'the geometric model'. It's this 'Mesh Breps' component that has so much influence on the calculation time and that we should have avoided.
brep = Brep(flatten([edgesrf, edgesrf_6, edgesrf_5, edgesrf_2, edgesrf_7, edgesrf_8, edgesrf_3, edgesrf_4]))
join = BrepJoin(Breps=brep)  # -> Breps, Closed

# ----
# Maximum weight of one element
area_4 = Area(Geometry=brep)  # -> flatten(Area), Centroid
sort_7 = SortList(Keys=area_4.Area)  # -> reverse(Keys), ValuesA
num_4 = Number(expr("x/1000", thickness))
panel_6 = Panel(num_4)
item_8 = ListItem(List=sort_7.Keys, Index=0, Wrap=True)
mm_3 = MassMultiplication(Input=[item_8, panel_6, "7800"])  # -> Result, PartialResults

# ---- group: Output to bake to Rhino
basketball_court_box = Box(boxrec)
basispunten = Point([move.Geometry, move_2.Geometry, move_3.Geometry, pt_5, pt_6, move_4.Geometry, pt_7, pt_9, pt_8])
wireframe = Line([ln_7, ln_8, ln_9, ln_10, ln_11, ln_12, crv_2])
mesh = Mesh(join.Breps)
curves = Curve([intcrv.Curve, intcrv_2.Curve, intcrv_3.Curve])

# ----
# Mesh snow/maintenance load:
# This part creates a mesh of al the elements that have an angle with the base plane smaller than °
base_plane = BasePlane()
flip_6 = Flip(Surface=edgesrf, Guide=base_plane)  # -> Surface, Result
flip_7 = Flip(Surface=edgesrf_4, Guide=base_plane)  # -> Surface, Result
flip_8 = Flip(Surface=edgesrf_2, Guide=base_plane)  # -> Surface, Result
flip_9 = Flip(Surface=edgesrf_3, Guide=base_plane)  # -> Surface, Result
pt_34 = ConstructPoint(XCoordinate="0.5", YCoordinate="0.5", ZCoordinate=0)
pt_35 = ConstructPoint(XCoordinate="0.5", YCoordinate="0.5", ZCoordinate=0)
pt_36 = ConstructPoint(XCoordinate="0.5", YCoordinate="-0.5", ZCoordinate=0)
pt_37 = ConstructPoint(XCoordinate="0.5", YCoordinate="-0.5", ZCoordinate=0)
evalsrf_6 = EvaluateSurface(Surface=flip_6.Surface, Point=pt_34)  # -> Point, Normal, Frame
evalsrf_7 = EvaluateSurface(Surface=flip_7.Surface, Point=pt_35)  # -> Point, Normal, Frame
evalsrf_8 = EvaluateSurface(Surface=flip_8.Surface, Point=pt_36)  # -> Point, Normal, Frame
evalsrf_9 = EvaluateSurface(Surface=flip_9.Surface, Point=pt_37)  # -> Point, Normal, Frame
pdecon_13 = Deconstruct(Point=evalsrf_6.Normal)  # -> XComponent, YComponent, ZComponent
pdecon_14 = Deconstruct(Point=evalsrf_7.Normal)  # -> XComponent, YComponent, ZComponent
pdecon_15 = Deconstruct(Point=evalsrf_8.Normal)  # -> XComponent, YComponent, ZComponent
pdecon_16 = Deconstruct(Point=evalsrf_9.Normal)  # -> XComponent, YComponent, ZComponent
sqr = Square(Value=pdecon_13.YComponent)
sqr_2 = Square(Value=pdecon_13.ZComponent)
sqr_3 = Square(Value=pdecon_14.YComponent)
sqr_4 = Square(Value=pdecon_14.ZComponent)
sqr_5 = Square(Value=pdecon_15.YComponent)
sqr_6 = Square(Value=pdecon_15.ZComponent)
sqr_7 = Square(Value=pdecon_16.YComponent)
sqr_8 = Square(Value=pdecon_16.ZComponent)
addition_10 = Addition(A=sqr, B=sqr_2)
addition_11 = Addition(A=sqr_3, B=sqr_4)
addition_12 = Addition(A=sqr_5, B=sqr_6)
addition_13 = Addition(A=sqr_7, B=sqr_8)
division_5 = Division(A=pdecon_13.ZComponent, B=addition_10)
division_6 = Division(A=pdecon_14.ZComponent, B=addition_11)
division_7 = Division(A=pdecon_15.ZComponent, B=addition_12)
division_8 = Division(A=pdecon_16.ZComponent, B=addition_13)
abs = Absolute(Value=division_5)
abs_2 = Absolute(Value=division_6)
abs_3 = Absolute(Value=division_7)
abs_4 = Absolute(Value=division_8)
deg = Degrees(Radians=abs)
deg_2 = Degrees(Radians=abs_2)
deg_3 = Degrees(Radians=abs_3)
deg_4 = Degrees(Radians=abs_4)
larger = LargerThan(FirstNumber=deg, SecondNumber="30")  # -> LargerThan, OrEqualTo
larger_2 = LargerThan(FirstNumber=deg_2, SecondNumber="30")  # -> LargerThan, OrEqualTo
larger_3 = LargerThan(FirstNumber=deg_3, SecondNumber="30")  # -> LargerThan, OrEqualTo
larger_4 = LargerThan(FirstNumber=deg_4, SecondNumber="30")  # -> LargerThan, OrEqualTo
cull_9 = CullPattern(List=flip_6.Surface, CullPattern=larger.LargerThan)
cull_10 = CullPattern(List=flip_7.Surface, CullPattern=larger_2.LargerThan)
cull_11 = CullPattern(List=flip_8.Surface, CullPattern=larger_3.LargerThan)
cull_12 = CullPattern(List=flip_9.Surface, CullPattern=larger_4.LargerThan)
brep_2 = Brep(flatten([cull_9, cull_10, cull_11, cull_12]))
join_2 = BrepJoin(Breps=brep_2)  # -> Breps, Closed

# ----
# Calculation of the maintenance load
project_2 = Project(Geometry=join_2.Breps, Plane=PlaneXY(0, 0, 0))  # -> Geometry, Transform
area_5 = Area(Geometry=project_2.Geometry)  # -> Area, Centroid
ma_2 = MassAddition(Input=area_5.Area)  # -> Result, PartialResults
expression_15 = Expression(x=ma_2.Result, Expression="(0.8-x/100)")
max_3 = Maximum(A=expression_15, B="0.2")

pdecon_17 = Deconstruct(Point=evalsrf_2.Normal)  # -> XComponent, YComponent, ZComponent
pdecon_18 = Deconstruct(Point=evalsrf_3.Normal)  # -> XComponent, YComponent, ZComponent
pdecon_19 = Deconstruct(Point=evalsrf_4.Normal)  # -> XComponent, YComponent, ZComponent
pdecon_20 = Deconstruct(Point=evalsrf_5.Normal)  # -> XComponent, YComponent, ZComponent
sqr_9 = Square(Value=pdecon_17.YComponent)
sqr_10 = Square(Value=pdecon_17.ZComponent)
sqr_11 = Square(Value=pdecon_18.YComponent)
sqr_12 = Square(Value=pdecon_18.ZComponent)
sqr_13 = Square(Value=pdecon_19.YComponent)
sqr_14 = Square(Value=pdecon_19.ZComponent)
sqr_15 = Square(Value=pdecon_20.YComponent)
sqr_16 = Square(Value=pdecon_20.ZComponent)
addition_14 = Addition(A=sqr_9, B=sqr_10)
addition_15 = Addition(A=sqr_11, B=sqr_12)
addition_16 = Addition(A=sqr_13, B=sqr_14)
addition_17 = Addition(A=sqr_15, B=sqr_16)
division_9 = Division(A=pdecon_17.YComponent, B=addition_14)
division_10 = Division(A=pdecon_18.YComponent, B=addition_15)
division_11 = Division(A=pdecon_19.YComponent, B=addition_16)
division_12 = Division(A=pdecon_20.YComponent, B=addition_17)
abs_5 = Absolute(Value=division_9)
abs_6 = Absolute(Value=division_10)
abs_7 = Absolute(Value=division_11)
abs_8 = Absolute(Value=division_12)
acos = ArcCosine(Value=division_9)
acos_2 = ArcCosine(Value=division_10)
acos_3 = ArcCosine(Value=division_11)
acos_4 = ArcCosine(Value=division_12)
deg_5 = Degrees(Radians=acos)
deg_6 = Degrees(Radians=acos_2)
deg_7 = Degrees(Radians=acos_3)
deg_8 = Degrees(Radians=acos_4)
larger_5 = LargerThan(FirstNumber=deg_5, SecondNumber="135")  # -> LargerThan, OrEqualTo
larger_6 = LargerThan(FirstNumber=deg_6, SecondNumber="135")  # -> LargerThan, OrEqualTo
larger_7 = LargerThan(FirstNumber=deg_7, SecondNumber="135")  # -> LargerThan, OrEqualTo
larger_8 = LargerThan(FirstNumber=deg_8, SecondNumber="135")  # -> LargerThan, OrEqualTo
cull_13 = CullPattern(List=flip_2.Surface, CullPattern=larger_5.OrEqualTo)
cull_14 = CullPattern(List=flip_3.Surface, CullPattern=larger_6.OrEqualTo)
cull_15 = CullPattern(List=flip_4.Surface, CullPattern=larger_7.OrEqualTo)
cull_16 = CullPattern(List=flip_5.Surface, CullPattern=larger_8.OrEqualTo)
brep_3 = Brep(flatten([cull_13, cull_14, cull_15, cull_16]))
join_3 = BrepJoin(Breps=brep_3)  # -> Breps, Closed

pdecon_21 = Deconstruct(Point=evalsrf_2.Normal)  # -> XComponent, YComponent, ZComponent
pdecon_22 = Deconstruct(Point=evalsrf_3.Normal)  # -> XComponent, YComponent, ZComponent
pdecon_23 = Deconstruct(Point=evalsrf_4.Normal)  # -> XComponent, YComponent, ZComponent
pdecon_24 = Deconstruct(Point=evalsrf_5.Normal)  # -> XComponent, YComponent, ZComponent
sqr_17 = Square(Value=pdecon_21.YComponent)
sqr_18 = Square(Value=pdecon_21.ZComponent)
sqr_19 = Square(Value=pdecon_22.YComponent)
sqr_20 = Square(Value=pdecon_22.ZComponent)
sqr_21 = Square(Value=pdecon_23.YComponent)
sqr_22 = Square(Value=pdecon_23.ZComponent)
sqr_23 = Square(Value=pdecon_24.YComponent)
sqr_24 = Square(Value=pdecon_24.ZComponent)
addition_18 = Addition(A=sqr_17, B=sqr_18)
addition_19 = Addition(A=sqr_19, B=sqr_20)
addition_20 = Addition(A=sqr_21, B=sqr_22)
addition_21 = Addition(A=sqr_23, B=sqr_24)
division_13 = Division(A=pdecon_21.YComponent, B=addition_18)
division_14 = Division(A=pdecon_22.YComponent, B=addition_19)
division_15 = Division(A=pdecon_23.YComponent, B=addition_20)
division_16 = Division(A=pdecon_24.YComponent, B=addition_21)
abs_9 = Absolute(Value=division_13)
abs_10 = Absolute(Value=division_14)
abs_11 = Absolute(Value=division_15)
abs_12 = Absolute(Value=division_16)
acos_5 = ArcCosine(Value=abs_9)
acos_6 = ArcCosine(Value=abs_10)
acos_7 = ArcCosine(Value=abs_11)
acos_8 = ArcCosine(Value=abs_12)
deg_9 = Degrees(Radians=acos_5)
deg_10 = Degrees(Radians=acos_6)
deg_11 = Degrees(Radians=acos_7)
deg_12 = Degrees(Radians=acos_8)
larger_9 = LargerThan(FirstNumber=deg_9, SecondNumber="45")  # -> LargerThan, OrEqualTo
larger_10 = LargerThan(FirstNumber=deg_10, SecondNumber="45")  # -> LargerThan, OrEqualTo
larger_11 = LargerThan(FirstNumber=deg_11, SecondNumber="45")  # -> LargerThan, OrEqualTo
larger_12 = LargerThan(FirstNumber=deg_12, SecondNumber="45")  # -> LargerThan, OrEqualTo
cull_17 = CullPattern(List=flip_3.Surface, CullPattern=larger_10.LargerThan)
cull_18 = CullPattern(List=flip_4.Surface, CullPattern=larger_11.LargerThan)
cull_19 = CullPattern(List=flip_5.Surface, CullPattern=larger_12.LargerThan)
cull_20 = CullPattern(List=flip_2.Surface, CullPattern=larger_9.LargerThan)
brep_4 = Brep(flatten([cull_20, cull_17, cull_18, cull_19]))
join_4 = BrepJoin(Breps=brep_4)  # -> Breps, Closed

pdecon_25 = Deconstruct(Point=evalsrf_2.Normal)  # -> XComponent, YComponent, ZComponent
pdecon_26 = Deconstruct(Point=evalsrf_3.Normal)  # -> XComponent, YComponent, ZComponent
pdecon_27 = Deconstruct(Point=evalsrf_4.Normal)  # -> XComponent, YComponent, ZComponent
pdecon_28 = Deconstruct(Point=evalsrf_5.Normal)  # -> XComponent, YComponent, ZComponent
sqr_25 = Square(Value=pdecon_25.YComponent)
sqr_26 = Square(Value=pdecon_25.ZComponent)
sqr_27 = Square(Value=pdecon_26.YComponent)
sqr_28 = Square(Value=pdecon_26.ZComponent)
sqr_29 = Square(Value=pdecon_27.YComponent)
sqr_30 = Square(Value=pdecon_27.ZComponent)
sqr_31 = Square(Value=pdecon_28.YComponent)
sqr_32 = Square(Value=pdecon_28.ZComponent)
addition_22 = Addition(A=sqr_25, B=sqr_26)
addition_23 = Addition(A=sqr_27, B=sqr_28)
addition_24 = Addition(A=sqr_29, B=sqr_30)
addition_25 = Addition(A=sqr_31, B=sqr_32)
division_17 = Division(A=pdecon_25.YComponent, B=addition_22)
division_18 = Division(A=pdecon_26.YComponent, B=addition_23)
division_19 = Division(A=pdecon_27.YComponent, B=addition_24)
division_20 = Division(A=pdecon_28.YComponent, B=addition_25)
abs_13 = Absolute(Value=division_17)
abs_14 = Absolute(Value=division_18)
abs_15 = Absolute(Value=division_19)
abs_16 = Absolute(Value=division_20)
acos_9 = ArcCosine(Value=division_17)
acos_10 = ArcCosine(Value=division_18)
acos_11 = ArcCosine(Value=division_19)
acos_12 = ArcCosine(Value=division_20)
deg_13 = Degrees(Radians=acos_9)
deg_14 = Degrees(Radians=acos_10)
deg_15 = Degrees(Radians=acos_11)
deg_16 = Degrees(Radians=acos_12)
smaller = SmallerThan(FirstNumber=deg_13, SecondNumber="45")  # -> SmallerThan, OrEqualTo
smaller_2 = SmallerThan(FirstNumber=deg_14, SecondNumber="45")  # -> SmallerThan, OrEqualTo
smaller_3 = SmallerThan(FirstNumber=deg_15, SecondNumber="45")  # -> SmallerThan, OrEqualTo
smaller_4 = SmallerThan(FirstNumber=deg_16, SecondNumber="45")  # -> SmallerThan, OrEqualTo
cull_21 = CullPattern(List=flip_2.Surface, CullPattern=smaller.OrEqualTo)
cull_22 = CullPattern(List=flip_3.Surface, CullPattern=smaller_2.OrEqualTo)
cull_23 = CullPattern(List=flip_4.Surface, CullPattern=smaller_3.OrEqualTo)
cull_24 = CullPattern(List=flip_5.Surface, CullPattern=smaller_4.OrEqualTo)
brep_5 = Brep(flatten([cull_21, cull_22, cull_23, cull_24]))
join_5 = BrepJoin(Breps=brep_5)  # -> Breps, Closed

xz = XZPlane(Origin=Point(0, 0, 0))
project_3 = Project(Geometry=join_3.Breps, Plane=xz)  # -> Geometry, Transform
area_6 = Area(Geometry=project_3.Geometry)  # -> Area, Centroid
ma_3 = MassAddition(Input=area_6.Area)  # -> Result, PartialResults

xz_2 = XZPlane(Origin=Point(0, 0, 0))
project_4 = Project(Geometry=join_4.Breps, Plane=xz_2)  # -> Geometry, Transform
area_7 = Area(Geometry=project_4.Geometry)  # -> Area, Centroid

# ----
# Creation of three different meshes for the wind load based on the angles of the elements.
ma_4 = MassAddition(Input=area_7.Area)  # -> Result, PartialResults

xz_3 = XZPlane(Origin=Point(0, 0, 0))
project_5 = Project(Geometry=join_5.Breps, Plane=xz_3)  # -> flatten(Geometry), Transform
area_8 = Area(Geometry=project_5.Geometry)  # -> Area, Centroid
ma_5 = MassAddition(Input=area_8.Area)  # -> Result, PartialResults

# ----
# Calculation of the characteristic value of the three different windloads
extreme_stuwdruk = Panel(expression_14)
drukcoëfficiënt_1 = Panel(multiplication_5)
drukcoëfficiënt_2 = Panel(subtraction_5)
drukcoëfficiënt_3 = Panel("-0.4")
cscd = Panel("1")

# ----
# Calculation of the serviceability limit state loads used for the displacement.
permanent_load = Panel("1.2")
snow_load = Panel(mm.Result)
ψ = Panel("0")
ψ_2 = Panel("1")
ψ_3 = Panel("0.3")
maintenance_load = Panel(max_3)
mm_4 = MassMultiplication(Input=[snow_load, ψ_2])  # -> Result, PartialResults
mm_5 = MassMultiplication(Input=[maintenance_load, ψ])  # -> Result, PartialResults
loading_case = Panel("1")
Z_2 = UnitZ(Factor=expr("-x", 1))
Z_3 = UnitZ(Factor=expr("-x", permanent_load))
Z_4 = UnitZ(Factor=expr("-x", mm_4.Result))
Z_5 = UnitZ(Factor=expr("-x", mm_5.Result))
loads = LoadsKaramba(Vector=Z_2, LCase=loading_case, mode="Gravity")

# ----
# Calculation of the ultimit limit state loads used for the stress.
γ = Panel("1.35")
permanent_load_2 = Panel("1.2")
γ_2 = Panel("1.35")
snow_load_2 = Panel(mm.Result)
γ_3 = Panel("1.5")
ψ_4 = Panel("1")
γ_4 = Panel("1.5")
ψ_5 = Panel("0.3")
maintenance_load_2 = Panel(max_3)
γ_5 = Panel("1.5")
ψ_6 = Panel("0")
multiplication_8 = Multiplication(A=permanent_load_2, B=γ_2)
mm_6 = MassMultiplication(Input=[snow_load_2, γ_3, ψ_4])  # -> Result, PartialResults
mm_7 = MassMultiplication(Input=[maintenance_load_2, γ_5, ψ_6])  # -> Result, PartialResults
loading_case_2 = Panel("0")
Z_6 = UnitZ(Factor=expr("-x", γ))
Z_7 = UnitZ(Factor=expr("-x", multiplication_8))
Z_8 = UnitZ(Factor=expr("-x", mm_6.Result))
Z_9 = UnitZ(Factor=expr("-x", mm_7.Result))
loads_2 = LoadsKaramba(Vector=Z_6, LCase=loading_case_2, mode="Gravity")

matselect = MaterialSelectionKaramba(menu=[dropdown(1), dropdown(4)])
crossecs = CrossSectionsKaramba(Heights_cm=expr("x/10", thickness), mode="Shell")
supp = SupportKaramba(PosInd=flatten(divide_4.Points), menu=[buttons(on, on, on, off, off, off)])

panel_7 = Panel("Local fitness stress")

# ----
# Maximum Von Mises Stress
number_slider = Slider(-1, range=-1..1)

panel_8 = Panel("Local fitness displacement")

# ----
# Visualisation of the displacement and the stress on the mesh with the same colour scale as in Diamonds. When not needed it is best to disable this part to reduce the optimisation time.
panel_9 = Panel("0.05")

panel_10 = Panel("Maximum displacement")

# ----
# Calculation of the mesh resolution based on the size of the elements.
panel_11 = Panel("5")

# ----
# Input values for the fitness functions
total_length_m = Panel(ma.Result)
element_length = Panel(item_6)
element_width = Panel(item_7)
element_weight = Panel(mm_3.Result)

division_21 = Division(A=element_length, B=panel_11)
min = Minimum(A=division_21, B="1.5")
max_4 = Maximum(A=min, B="0.5")
multiplication_9 = Multiplication(A=max_4, B="20")
round_2 = Round(Number=multiplication_9)  # -> Nearest, Floor, Ceiling
division_22 = Division(A=round_2.Nearest, B="20")
panel_12 = Panel(division_22)

# ---- group: The geometric model (continued)
mesh_breps = MeshBreps(
    Brep=join.Breps,
    MeshResolution=division_22,
    EdgeRefinementFactor=0.67,
    PointReduction=Toggle(False),
    SmoothingStepSize=0,
    SmoothingIterations=5)  # -> flatten(Mesh), Info

# ----
mesh_breps_2 = MeshBreps(
    Brep=join_3.Breps,
    MeshResolution=division_22,
    EdgeRefinementFactor=0.67,
    PointReduction=False,
    SmoothingStepSize=0,
    SmoothingIterations=5)  # -> flatten(Mesh), Info

mesh_breps_3 = MeshBreps(
    Brep=join_4.Breps,
    MeshResolution=division_22,
    EdgeRefinementFactor=0.67,
    PointReduction=False,
    SmoothingStepSize=0,
    SmoothingIterations=5)  # -> flatten(Mesh), Info

mesh_breps_4 = MeshBreps(
    Brep=join_5.Breps,
    MeshResolution=division_22,
    EdgeRefinementFactor=0.67,
    PointReduction=False,
    SmoothingStepSize=0,
    SmoothingIterations=5)  # -> flatten(Mesh), Info

mesh_breps_5 = MeshBreps(
    Brep=join_2.Breps,
    MeshResolution=division_22,
    EdgeRefinementFactor=0.67,
    PointReduction=False,
    SmoothingStepSize=0,
    SmoothingIterations=5)  # -> flatten(Mesh), Info

area_9 = Area(Geometry=mesh_breps_2.Mesh)  # -> Area, Centroid
ma_6 = MassAddition(Input=area_9.Area)  # -> Result, PartialResults
division_23 = Division(A=ma_3.Result, B=ma_6.Result)

area_10 = Area(Geometry=mesh_breps_4.Mesh)  # -> Area, Centroid
ma_7 = MassAddition(Input=area_10.Area)  # -> Result, PartialResults
division_24 = Division(A=ma_5.Result, B=ma_7.Result)

area_11 = Area(Geometry=mesh_breps_3.Mesh)  # -> Area, Centroid
ma_8 = MassAddition(Input=area_11.Area)  # -> Result, PartialResults
division_25 = Division(A=ma_4.Result, B=ma_8.Result)

opp_wind_1 = Panel(division_23)
opp_wind_2 = Panel(division_25)
opp_wind_3 = Panel(division_24)
mm_8 = MassMultiplication(Input=[extreme_stuwdruk, drukcoëfficiënt_1, cscd, division_23])  # -> Result, PartialResults
mm_9 = MassMultiplication(Input=[extreme_stuwdruk, cscd, opp_wind_2, drukcoëfficiënt_2])  # -> Result, PartialResults
mm_10 = MassMultiplication(Input=[extreme_stuwdruk, cscd, opp_wind_3, drukcoëfficiënt_3])  # -> Result, PartialResults

windload_c = Panel(mm_10.Result)
windload_a = Panel(mm_8.Result)
windload_b = Panel(mm_9.Result)
mm_11 = MassMultiplication(Input=[windload_a, ψ_3])  # -> Result, PartialResults
mm_12 = MassMultiplication(Input=[windload_b, ψ_3])  # -> Result, PartialResults
mm_13 = MassMultiplication(Input=[windload_c, ψ_3])  # -> Result, PartialResults
Z_10 = UnitZ(Factor=mm_12.Result)  # -> expr("-x", UnitVector)
Y = UnitY(Factor=mm_13.Result)  # -> expr("-x", UnitVector)
Y_2 = UnitY(Factor=mm_11.Result)
loads_3 = LoadsKaramba(Vector=Y_2, Mesh=mesh_breps_2.Mesh, LCase=loading_case, mode="Mesh Load", menu=[buttons(off, off, on), buttons(on, off)])  # -> flatten(Load)
loads_4 = LoadsKaramba(
    Vector=Z_10,
    Mesh=mesh_breps_3.Mesh,
    LCase=loading_case,
    mode="Mesh Load",
    menu=[buttons(off, off, on), buttons(on, off)])  # -> flatten(Load)
loads_5 = LoadsKaramba(Vector=Y, Mesh=mesh_breps_4.Mesh, LCase=loading_case, mode="Mesh Load", menu=[buttons(off, off, on), buttons(on, off)])  # -> flatten(Load)
loads_6 = LoadsKaramba(Vector=Z_3, Mesh=mesh_breps.Mesh, LCase=loading_case, mode="Mesh Load", menu=[buttons(off, on, off), buttons(on, off)])
loads_7 = LoadsKaramba(Vector=Z_4, Mesh=mesh_breps_5.Mesh, LCase=loading_case, mode="Mesh Load", menu=[buttons(off, off, on), buttons(on, off)])
loads_8 = LoadsKaramba(Vector=Z_5, Mesh=mesh_breps_5.Mesh, LCase=loading_case, mode="Mesh Load", menu=[buttons(off, off, on), buttons(on, off)])

wind_load_a = Panel(mm_8.Result)
wind_load_b = Panel(mm_9.Result)
wind_load_c = Panel(mm_10.Result)
mm_14 = MassMultiplication(Input=[wind_load_a, γ_4, ψ_5])  # -> Result, PartialResults
mm_15 = MassMultiplication(Input=[wind_load_b, γ_4, ψ_5])  # -> Result, PartialResults
mm_16 = MassMultiplication(Input=[wind_load_c, γ_4, ψ_5])  # -> Result, PartialResults
Z_11 = UnitZ(Factor=mm_15.Result)  # -> expr("-x", UnitVector)
Y_3 = UnitY(Factor=mm_16.Result)  # -> expr("-x", UnitVector)
Y_4 = UnitY(Factor=mm_14.Result)
loads_9 = LoadsKaramba(
    Vector=Y_4,
    Mesh=mesh_breps_2.Mesh,
    LCase=loading_case_2,
    mode="Mesh Load",
    menu=[buttons(off, off, on), buttons(on, off)])  # -> flatten(Load)
loads_10 = LoadsKaramba(
    Vector=Z_11,
    Mesh=mesh_breps_3.Mesh,
    LCase=loading_case_2,
    mode="Mesh Load",
    menu=[buttons(off, off, on), buttons(on, off)])  # -> flatten(Load)
loads_11 = LoadsKaramba(
    Vector=Y_3,
    Mesh=mesh_breps_4.Mesh,
    LCase=loading_case_2,
    mode="Mesh Load",
    menu=[buttons(off, off, on), buttons(on, off)])  # -> flatten(Load)
loads_12 = LoadsKaramba(Vector=Z_7, Mesh=mesh_breps.Mesh, LCase=loading_case_2, mode="Mesh Load", menu=[buttons(off, on, off), buttons(on, off)])
loads_13 = LoadsKaramba(
    Vector=Z_8,
    Mesh=mesh_breps_5.Mesh,
    LCase=loading_case_2,
    mode="Mesh Load",
    menu=[buttons(off, off, on), buttons(on, off)])
loads_14 = LoadsKaramba(
    Vector=Z_9,
    Mesh=mesh_breps_5.Mesh,
    LCase=loading_case_2,
    mode="Mesh Load",
    menu=[buttons(off, off, on), buttons(on, off)])

meshtoshell = MeshToShellKaramba(Point=flatten(divide_4.Points), Mesh=mesh_breps.Mesh, LDist=0.005)  # -> Point, Element, Info

# ----
# Analysing  and visualising components of Karamba
assemble = AssembleModelKaramba(
    Point=meshtoshell.Point,
    Elem=meshtoshell.Element,
    Support=supp,
    Load=[loads_9, loads_10, loads_11, loads, loads_6, loads_7, loads_3, loads_4, loads_5, loads_8, loads_2, loads_12, loads_13, loads_14],
    CrossSection=crossecs,
    Material=matselect,
    LDist=0.005)  # -> Model, Info, Mass, CenterOfGravity
analyze = AnalyzeKaramba(Model=assemble.Model)  # -> ModelWithDisplacements, MaximumDisplacement_m, ResultingForceOfGravity_kN, ElasticEnergy_kNm
modelview = ModelViewKaramba(Model=analyze.ModelWithDisplacements, LoadCaseFactorsForLinearSuperposition=1, IndexIncrementOfVisibleLoadcase=0)  # -> Model, MeshOfRendering, DeformedStructure, DeformedModel
shellview = ShellViewKaramba(Model=modelview.Model)  # -> Model, MeshOfRendering, LegendColors, LegendTags
legend = Legend(Colour=shellview.LegendColors, Tags=shellview.LegendTags, LegendType=1)

facen = FaceNormals(Mesh=shellview.MeshOfRendering)  # -> flatten(Centers), Normals
shellvecresults = ResultVectorsOnShellsKaramba(AnalyzedModel=modelview.Model, Layer=Slider(-1, range=-1..1), mode="PrincStress")  # -> AnalyzedModel, Points, FirstPrincipalStressDirection, SecondPrincipalStressDirection
project_6 = Project(Geometry=facen.Centers, Plane=PlaneXY(0, 0, 0))  # -> Geometry, Transform
cp = ClosestPoint(Point=trim, Cloud=project_6.Geometry)  # -> ClosestPoint, CPIndex, Distance
vlen = VectorLength(Vector=shellvecresults.FirstPrincipalStressDirection)
vlen_2 = VectorLength(Vector=shellvecresults.SecondPrincipalStressDirection)
item_9 = ListItem(List=vlen, Index=cp.CPIndex, Wrap=True)
item_10 = ListItem(List=vlen_2, Index=cp.CPIndex, Wrap=True)
expression_16 = Expression(x=item_9, y=item_10, Expression="((x^2-x*y+y^2+3*((x-y)/2)^2)^(1/2))*10")  # -> simplify(R)
sort_8 = SortList(Keys=expression_16)  # -> reverse(Keys), ValuesA
first_last_13 = FirstLast(List=sort_8.Keys)  # -> flatten(FirstValue), LastValue

shellvecresults_2 = ResultVectorsOnShellsKaramba(AnalyzedModel=shellview.Model, Layer=Slider(-1, range=-1..1), mode="PrincStress")  # -> AnalyzedModel, Points, FirstPrincipalStressDirection, SecondPrincipalStressDirection
vlen_3 = VectorLength(Vector=shellvecresults_2.SecondPrincipalStressDirection)
vlen_4 = VectorLength(Vector=shellvecresults_2.FirstPrincipalStressDirection)
expression_17 = Expression(x=vlen_4, y=vlen_3, Expression="((x^2-x*y+y^2+3*((x-y)/2)^2)^(1/2))*10")
gradient = Gradient(
    LowerLimit=0,
    UpperLimit="355",
    Parameter=expression_17,
    stops=[0: RGB(201, 123, 25), 0: RGB(213, 203, 66), 0: RGB(168, 204, 199), 0: RGB(170, 235, 209), 0: RGB(140, 117, 33), 0: RGB(44, 48, 165), 0.25: RGB(59, 203, 214), 0.504: RGB(0, 128, 0), 0.748: RGB(255, 255, 0), 1: RGB(255, 0, 0)])
facen_2 = FaceNormals(Mesh=shellview.MeshOfRendering)  # -> flatten(Centers), Normals
colmesh = ColourMesh(Points=facen_2.Centers, Colours=gradient, Mesh=shellview.MeshOfRendering, Boolean=True)

# ----
# Visualisation of the local elements
explode = MeshExplode(Mesh=shellview.MeshOfRendering, Interpolate=False)
item_11 = ListItem(List=flatten(explode), Index=cp.CPIndex, Wrap=True)
item_12 = ListItem(List=flatten(facen.Centers), Index=cp.CPIndex, Wrap=True)

nodedisp = NodalDisplacementsKaramba(AnalyzedModel=analyze.ModelWithDisplacements)  # -> AnalyzedModel, NodalTranslations_m, NodalRotations_rad
vlen_5 = VectorLength(Vector=nodedisp.NodalTranslations_m)
trim_20 = TrimDataEnds(Data=vlen_5, ListStart=0, ListEnd=0, PathStart=1, PathEnd=0, RenumberPaths=True)  # -> simplify(TrimmedData)
gradient_2 = Gradient(
    LowerLimit=0,
    UpperLimit=panel_9,
    Parameter=trim_20,
    stops=[0: RGB(201, 123, 25), 0: RGB(213, 203, 66), 0: RGB(168, 204, 199), 0: RGB(170, 235, 209), 0: RGB(140, 117, 33), 0: RGB(44, 48, 165), 0.25: RGB(59, 203, 214), 0.504: RGB(0, 128, 0), 0.748: RGB(255, 255, 0), 1: RGB(255, 0, 0)])
colmesh_2 = ColourMesh(Points=meshtoshell.Point, Colours=gradient_2, Mesh=shellview.MeshOfRendering, Boolean=True)

shellvecresults_3 = ResultVectorsOnShellsKaramba(AnalyzedModel=modelview.Model, Layer=number_slider, mode="PrincStress")  # -> AnalyzedModel, Points, FirstPrincipalStressDirection, SecondPrincipalStressDirection
vlen_6 = VectorLength(Vector=shellvecresults_3.SecondPrincipalStressDirection)
vlen_7 = VectorLength(Vector=shellvecresults_3.FirstPrincipalStressDirection)
expression_18 = Expression(x=vlen_7, y=vlen_6, Expression="(x^2-x*y+y^2+3*((x-y)/2)^2)^(1/2)")
multiplication_10 = Multiplication(A=expression_18, B=10)
sort_9 = SortList(Keys=multiplication_10)  # -> reverse(Keys), ValuesA
item_13 = ListItem(List=sort_9.Keys, Index=0, Wrap=True)

nodedisp_2 = NodalDisplacementsKaramba(AnalyzedModel=analyze.ModelWithDisplacements)  # -> AnalyzedModel, NodalTranslations_m, NodalRotations_rad
project_7 = Project(Geometry=meshtoshell.Point, Plane=PlaneXY(0, 0, 0))  # -> Geometry, Transform
cp_2 = ClosestPoint(Point=trim, Cloud=project_7.Geometry)  # -> ClosestPoint, CPIndex, Distance
vlen_8 = VectorLength(Vector=nodedisp_2.NodalTranslations_m)
trim_21 = TrimDataEnds(Data=vlen_8, ListStart=0, ListEnd=0, PathStart=1, PathEnd=0, RenumberPaths=True)  # -> simplify(TrimmedData)
item_14 = ListItem(List=trim_21, Index=cp_2.CPIndex, Wrap=True)
sort_10 = SortList(Keys=item_14)  # -> reverse(Keys), ValuesA
first_last_14 = FirstLast(List=sort_10.Keys)  # -> flatten(FirstValue), LastValue

first_last_15 = FirstLast(List=analyze.MaximumDisplacement_m)  # -> FirstValue, LastValue

# ----
# The optimisation process
mass_kg = Panel(assemble.Mass)
displacement_m = Panel(first_last_14.FirstValue)
stress_n_mm² = Panel(first_last_13.FirstValue)
max_stress_n_mm² = Panel(item_13)
maximum_displacement_m = Panel(first_last_15.LastValue)

max_displ = Panel(division)
max_displ_2 = Panel("0.05")
panel_13 = Panel("Fitness functions.")
massa_max = Panel("200000")
massa_min = Panel("0")
length_min = Panel("0")
length_min_2 = Panel("0")
width_min = Panel("0")
weight_min = Panel("0")
min_spanning = Panel("0")
length_max = Panel("5000")
element_length_max = Panel("14.6")
element_width_max = Panel("2.5")
element_weight_max = Panel("22000")
min_displ = Panel("0")
max_spanning = Panel("355")
min_2 = Minimum(A=max_displ, B=max_displ_2)
percent_massa = Expression(z=mass_kg, y=massa_max, x=massa_min, Expression="(z-x)/(y-x)")
percent_massa_2 = Expression(z=total_length_m, y=length_max, x=length_min, Expression="(z-x)/(y-x)")
percent_massa_3 = Expression(z=element_length, y=element_length_max, x=length_min_2, Expression="(z-x)/(y-x)")
percent_massa_4 = Expression(z=element_width, y=element_width_max, x=width_min, Expression="(z-x)/(y-x)")
percent_massa_5 = Expression(z=element_weight, y=element_weight_max, x=weight_min, Expression="(z-x)/(y-x)")
percent_massa_6 = Expression(z=displacement_m, y=min_2, x=min_displ, Expression="(z-x)/(y-x)")
percent_massa_7 = Expression(z=stress_n_mm², y=max_spanning, x=min_spanning, Expression="(z-x)/(y-x)")
expression_19 = Expression(x=num_2, y=num_3, z=num, Expression="if (x+y+z=399,0,-1)")
expression_20 = Expression(x=percent_massa_3, Expression="if (x<1,0,1-x²)")
expression_21 = Expression(x=percent_massa_4, Expression="if (x<1,0,1-x²)")
expression_22 = Expression(x=percent_massa_5, Expression="if (x<1,0,1-x²)")
expression_23 = Expression(x=percent_massa_6, Expression="if (x<1,0,1-x²)")
expression_24 = Expression(x=percent_massa_7, Expression="if (x<1,0,1-x²)")
expression_25 = Expression(x=percent_massa, Expression="1-x")
expression_26 = Expression(x=percent_massa_2, Expression="1-x")
fitness_value_max_displacement = Panel(expression_23)
fitness_value_length_wireframe = Panel(expression_26)
fitness_value_element_length = Panel(expression_20)
fitness_value_element_weight = Panel(expression_22)
fitness_value_element_width = Panel(expression_21)
fitness_value_total_mass = Panel(expression_25)
fitness_value_max_stress = Panel(expression_24)
validation_intersection = Panel(expression_19)
panel_14 = Panel(Slider(1, range=0..10))
panel_15 = Panel(Slider(10, range=0..10))
multiplication_11 = Multiplication(A=expression_25, B=panel_14)
multiplication_12 = Multiplication(A=expression_26, B=panel_15)
multiplication_13 = Multiplication(A=expression_20, B="1")
multiplication_14 = Multiplication(A=expression_21, B="1")
multiplication_15 = Multiplication(A=expression_22, B="1")
multiplication_16 = Multiplication(A=fitness_value_max_displacement, B="1")
multiplication_17 = Multiplication(A=expression_24, B="1")
ma_9 = MassAddition(Input=[panel_14, panel_15])  # -> Result, PartialResults
expression_27 = Expression(
    x=multiplication_11,
    y=multiplication_12,
    z=multiplication_13,
    b=multiplication_14,
    c=multiplication_15,
    u=multiplication_16,
    v=expression_19,
    w=multiplication_17,
    a=ma_9.Result,
    Expression="(x+y)/a+z+u+w+b+c+v")
panel_16 = Panel(ma_9.Result)
fitness_value = Panel(expression_27)

# ----
# Galapagos and the custom component that creates the output textfile
silder_names_to_include = Panel("Elements, Rows, Thickness, Ya, Yb, Yc, Yd, Ye, Yf, Zg, Zh, Zi, Xvar, Yvar")
galapagos = Galapagos(fitness=expression_27, gene=[elements, rows, thickness, ya, yd, zg, yc, yf, zi, yb, ye, zh, xvar, yvar])
path = FilePath("Write here the path u want the text file to be located in.")
c_script = CSharpScript(Fitness=expression_27, Sliders=silder_names_to_include, File=path)  # -> out, Record; inputs Fitness: Double, Sliders: String, File: String
# ---------- c_script: C# ----------
    // Create the line of text describing the current state.
    var sliders = FindSliders(Sliders);
    var sliderStates = new string[sliders.Length];
    for( int i = 0; i < sliders.Length; i++)
      sliderStates[i] = string.Format("{0}: {1}", sliders[i].NickName, sliders[i].Slider.GripText);
    var currentState = string.Format("{0:0.0000} ({1})", Fitness, string.Join(", ", sliderStates));

    // Append the current state to the file. This will create a new file if it already exists.
    System.IO.File.AppendAllLines(File, new string[] { currentState });

    // Output all data from the file.
    Record = System.IO.File.ReadAllLines(File);
# ---------- c_script: C# additional code ----------
  private Grasshopper.Kernel.Special.GH_NumberSlider[] FindSliders(string nameString)
  {
    string[] names = nameString.Split(",".ToCharArray());
    var array = new Grasshopper.Kernel.Special.GH_NumberSlider[names.Length];

    // Find all sliders by nickname.
    for (int i = 0; i < names.Length; i++)
    {
      string name = names[i].Trim();
      foreach (IGH_DocumentObject obj in GrasshopperDocument.Objects)
      {
        var slider = obj as Grasshopper.Kernel.Special.GH_NumberSlider;
        if (slider == null) continue;
        if (slider.NickName.Equals(name, StringComparison.Ordinal))
        {
          array[i] = slider;
          break;
        }
      }
      if (array[i] == null)
        throw new Exception("Slider with name: " + name + " could not be found.");
    }

    return array;
  }
# ---------- end c_script ----------
panel_17 = Panel(c_script.Record)

# ==== cluster BasePlane

pt = ConstructPoint(XCoordinate=0, YCoordinate=0, ZCoordinate=0)
pt_2 = ConstructPoint(XCoordinate="1", YCoordinate=0, ZCoordinate=0)
pt_3 = ConstructPoint(XCoordinate="1", YCoordinate="1", ZCoordinate=0)
pt_4 = ConstructPoint(XCoordinate=0, YCoordinate="1", ZCoordinate=0)
srf4pt = _4PointSurface(CornerA=pt, CornerB=pt_2, CornerC=pt_3, CornerD=pt_4)

S = ClusterOutput(srf4pt)
